# Dynamo graph create_drafting_view_1772251802535.dyn "Create Drafting View" (Dynamo 2.17.0.3472)

file_path = Filename("C:\Users\kvana\Downloads\Book1.xlsx")  # graph input
file_from_path = FileObject(path=file_path)
sheet_name = StringInput("Sheet1")  # graph input
boolean = BoolSelector(false)
importExcel = Data.ImportExcel(file=file_from_path, sheetName=sheet_name, readAsStrings=boolean)
transpose = List.Transpose(lists=importExcel)
code_block = CodeBlock { 0; }
getItemAtIndex = List.GetItemAtIndex(list=transpose, index=code_block)
python_script = Python(IN[0]=getItemAtIndex)  # IronPython2
# ---------- python_script.python (33 lines) ----------
import clr
clr.AddReference('RevitServices')
from RevitServices.Persistence import DocumentManager
from RevitServices.Transactions import TransactionManager

clr.AddReference('RevitAPI')
from Autodesk.Revit.DB import *

# Lấy tài liệu Revit hiện tại
doc = DocumentManager.Instance.CurrentDBDocument

# Nhận dữ liệu từ Dynamo
view_names = IN[0]  # Danh sách tên view từ Excel

# Lấy ViewFamilyType của Drafting View
view_family_types = FilteredElementCollector(doc).OfClass(ViewFamilyType).ToElements()
drafting_view_type = [v for v in view_family_types if v.ViewFamily == ViewFamily.Drafting][0]

# Kiểm tra đầu vào
if not view_names:
    OUT = "Không có dữ liệu đầu vào từ Excel."
else:
    views_created = []
    TransactionManager.Instance.EnsureInTransaction(doc)

    for name in view_names:
        # Tạo Drafting View mới
        drafting_view = ViewDrafting.Create(doc, drafting_view_type.Id)
        drafting_view.Name = name
        views_created.append(drafting_view)

    TransactionManager.Instance.TransactionTaskDone()
    OUT = views_created
# ----------------------------------------
