# Dynamo graph test_1772251173058.dyn "Create Sheet test" (Dynamo 2.5.0.7460)

file_path = Filename("Y:\01.Project\05.LEGO\00.AsBuilt\2.WIP\LIFT\DRAWING LIST-ALL.xlsx")  # graph input
file_from_path = FileObject(path=file_path)
excel_sheet_name = StringInput("")  # graph input
code_block = CodeBlock { false; }
importExcel = Data.ImportExcel(file=file_from_path, sheetName=excel_sheet_name, readAsStrings=code_block)
transpose = List.Transpose(lists=importExcel)
code_block_2 = CodeBlock { 1; }
getItemAtIndex = List.GetItemAtIndex(list=transpose, index=code_block_2)
code_block_3 = CodeBlock { 0; }
getItemAtIndex_2 = List.GetItemAtIndex(list=transpose, index=code_block_3)
family_types = FamilyTypes("LMV-A1 Frame-MOL-As-built DD:LMV-A1 Frame-MOL-As-built DD")  # graph input
views = Views("{3D - 0304201240}")  # graph input
byNameNumberTitleBlockAndView = Sheet.ByNameNumberTitleBlockAndView(sheetName=getItemAtIndex, sheetNumber=getItemAtIndex_2, titleBlockFamilyType=family_types, view=views)
code_block_4 = CodeBlock { ""; }
code_block_5 = CodeBlock { 1; }
getItemAtIndex_3 = List.GetItemAtIndex(list=transpose, index=code_block_5)
setParameterByName = Element.SetParameterByName(element=byNameNumberTitleBlockAndView, parameterName=code_block_4, value=getItemAtIndex_3)
code_block_6 = CodeBlock { ""; }
code_block_7 = CodeBlock { 2; }
getItemAtIndex_4 = List.GetItemAtIndex(list=transpose, index=code_block_7)
setParameterByName_2 = Element.SetParameterByName(element=byNameNumberTitleBlockAndView, parameterName=code_block_6, value=getItemAtIndex_4)
code_block_8 = CodeBlock { ""; }
code_block_9 = CodeBlock { 3; }
getItemAtIndex_5 = List.GetItemAtIndex(list=transpose, index=code_block_9)
setParameterByName_3 = Element.SetParameterByName(element=byNameNumberTitleBlockAndView, parameterName=code_block_8, value=getItemAtIndex_5)
code_block_10 = CodeBlock { ""; }
code_block_11 = CodeBlock { 4; }
getItemAtIndex_6 = List.GetItemAtIndex(list=transpose, index=code_block_11)
setParameterByName_4 = Element.SetParameterByName(element=byNameNumberTitleBlockAndView, parameterName=code_block_10, value=getItemAtIndex_6)
code_block_12 = CodeBlock { ""; }
code_block_13 = CodeBlock { 5; }
getItemAtIndex_7 = List.GetItemAtIndex(list=transpose, index=code_block_13)
setParameterByName_5 = Element.SetParameterByName(element=byNameNumberTitleBlockAndView, parameterName=code_block_12, value=getItemAtIndex_7)
code_block_14 = CodeBlock { ""; }
code_block_15 = CodeBlock { 6; }
getItemAtIndex_8 = List.GetItemAtIndex(list=transpose, index=code_block_15)
setParameterByName_6 = Element.SetParameterByName(element=byNameNumberTitleBlockAndView, parameterName=code_block_14, value=getItemAtIndex_8)
code_block_16 = CodeBlock { ""; }
code_block_17 = CodeBlock { 7; }
getItemAtIndex_9 = List.GetItemAtIndex(list=transpose, index=code_block_17)
setParameterByName_7 = Element.SetParameterByName(element=byNameNumberTitleBlockAndView, parameterName=code_block_16, value=getItemAtIndex_9)
code_block_18 = CodeBlock { ""; }
code_block_19 = CodeBlock { 8; }
getItemAtIndex_10 = List.GetItemAtIndex(list=transpose, index=code_block_19)
setParameterByName_8 = Element.SetParameterByName(element=byNameNumberTitleBlockAndView, parameterName=code_block_18, value=getItemAtIndex_10)
code_block_20 = CodeBlock { ""; }
code_block_21 = CodeBlock { 9; }
getItemAtIndex_11 = List.GetItemAtIndex(list=transpose, index=code_block_21)
setParameterByName_9 = Element.SetParameterByName(element=byNameNumberTitleBlockAndView, parameterName=code_block_20, value=getItemAtIndex_11)
code_block_22 = CodeBlock { ""; }
code_block_23 = CodeBlock { 10; }
getItemAtIndex_12 = List.GetItemAtIndex(list=transpose, index=code_block_23)
setParameterByName_10 = Element.SetParameterByName(element=byNameNumberTitleBlockAndView, parameterName=code_block_22, value=getItemAtIndex_12)
dropItems = List.DropItems()  # unwired: list, amount
code_block_24 = CodeBlock { 1; }
